vi "Main.gviweb"   [LabVIEW NXG 3.1.0]
panel controls:
  "Send Log": bool
  "Stop Test": bool
  "Start Test": bool
panel indicators:
  "Files Sent": f64
  "Buffer": f64
  "Temperature": f64[][]
  "Testing": bool
  "Hostname": string
  "Connection": string
  "Memory Percentage Used": f64
  "Disk Percentage Used": f64
uses:
  NI::Skyline::Configuration::Open Configuration.gvi
  Application::Get Hostname.gviweb
  NI::Skyline::TagHTTP::Query Tags.gvi
  NI::Skyline::TagHTTP::Multi Read.gvi
  NI::Skyline::MessageHTTP::Open.gvi
  NI::Skyline::MessageHTTP::Publish.gvi
  NI::Skyline::MessageHTTP::Close.gvi
diagram:
  w1 = ""  # Server
  call "Open Configuration.gvi"(server url=w1, username="", password="") -> (configuration=w2)
  w3 = "NI_cRIO-9049--SN-01234567--MAC-00-80-2F-AA-AA-AA"  # Target
  while {
    while {
      event (timeout = 500) {
        on Timeout {
          call "Get Hostname.gviweb"(configuration in=w2, minionID=w3) -> (configuration out=w4, Hostname=w5, Connection=w6)
          case (w6) {
            frame "Disconnected", Default {
              Property Node(instance in=reference to "Testing", "Value"=FALSE)
              w7 = TRUE
            }
            frame "Connected" {
              w8 = ["Health.Disk.UsePercentage", "Health.Memory.UsePercentage", "cRIO_Test_Cell.files_sent", "cRIO_Test_Cell.buffer", "cRIO_Test_Cell.testing"]
              for {
                w9 = each element of w8
                Concatenate Strings(w3, ".", w9) -> w11
                append w11 to w10
              }
              call "Query Tags.gvi"(paths=w10, configuration=w4) -> (tags=w12, error out=w13)
              call "Multi Read.gvi"(tags in=w12, error in=w13) -> (tag clusters=w14)
              for {
                w15 = each element of w14
                Property Node(instance in=w15) -> ("Path"=w16, "Value"=w17)
                Search Or Split String(search string/char=".", string=w16) -> (match + rest of string=w18)
                case (w18) {
                  frame ".Health.Disk.UsePercentage" {
                    Scan Value(format string="%f", string=w17) -> (value=w19)
                    $"Disk Percentage Used" <- w19
                  }
                  frame ".Health.Memory.UsePercentage" {
                    Scan Value(format string="%f", string=w17) -> (value=w20)
                    $"Memory Percentage Used" <- w20
                  }
                  frame ".cRIO_Test_Cell.files_sent" {
                    Scan Value(format string="%d", string=w17) -> (value=w21)
                    $"Files Sent" <- w21
                  }
                  frame ".cRIO_Test_Cell.buffer" {
                    Scan Value(format string="%d", string=w17) -> (value=w22)
                    $Buffer <- w22
                  }
                  frame ".cRIO_Test_Cell.testing" {
                    case (w17) {
                      frame "False", Default {
                        w23 = FALSE
                      }
                      frame "True" {
                        w23 = TRUE
                      }
                    }
                    $Testing <- w23
                  }
                  frame Default { }
                }
              }
              Concatenate Strings(w3, ".", "cRIO_Test_Cell.mod1.*") -> w24
              Build Array(w24) -> w25
              call "Query Tags.gvi"(paths=w25, configuration=w4) -> (tags=w26, error out=w27)
              call "Multi Read.gvi"(tags in=w26, error in=w27) -> (tag clusters=w28)
              for {
                w29 = each element of w28
                Property Node(instance in=w29) -> ("Value"=w31)
                Scan Value(format string="%f", string=w31) -> (value=w32)
                Build Array(w32) -> w33
                append w33 to w30
              }
              Transpose 2D Array(2D array=w30) -> (transposed array=w34)
              $Temperature <- w34
              w7 = FALSE
            }
          }
          Property Node(instance in=reference to "Stop Test", "Disabled"=w7)
          Property Node(instance in=reference to "Start Test", "Disabled"=w7)
          Property Node(instance in=reference to "Send Log", "Disabled"=w7)
          $Hostname <- w5
          $Connection <- w6
        }
        on "Send Log" Value changed {
          call "Open.gvi"(configuration=w2) -> (message session out=w35, error out=w36)
          call "Publish.gvi"(message session=w35, topic=w3, message="Send File", error in=w36) -> (message session out=w37, error out=w38)
          call "Close.gvi"(message session=w37, error in=w38)
        }
        on "Start Test" Value changed {
          call "Open.gvi"(configuration=w2) -> (message session out=w39, error out=w40)
          call "Publish.gvi"(message session=w39, topic=w3, message="Start Test", error in=w40) -> (message session out=w41, error out=w42)
          call "Close.gvi"(message session=w41, error in=w42)
        }
        on "Stop Test" Value changed {
          call "Open.gvi"(configuration=w2) -> (message session out=w43, error out=w44)
          call "Publish.gvi"(message session=w43, topic=w3, message="Stop Test", error in=w44) -> (message session out=w45, error out=w46)
          call "Close.gvi"(message session=w45, error in=w46)
        }
      }
      stop if FALSE
    }
    stop if FALSE
  }
